# Grasshopper definition GenerateCase.gh (Grasshopper 1.0.7)
# plug-ins: Human

output_directory = Panel("C:\Users\tgerrish\Documents\GitHub\oshe\projects")
weatherfile = Panel("C:\Users\tgerrish\Documents\GitHub\oshe\example\weatherfile.epw")
material = Panel("""BDG_CONTEXT
MediumRough
0.2032
1.95
2240
900
0.9
0.7
0""")
refreshall = Button()
material_2 = Panel("""GND_SURROUNDING
MediumRough
0.2
1.73
2243
837
0.9
0.65
0""")
ladybug = Ladybug_Ladybug()  # -> Vviiiiiiiiiizzz; plug-in component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
honeybee = Honeybee_Honeybee()  # -> Vviiiiiiiiiizzz; plug-in component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
material_3 = Panel("""GND_SAND
Rough
0.2
1.25
2100
810
0.88
0.7
0""")
material_4 = Panel("""GND_CONCRETE
MediumRough
0.2
1.73
2243
837
0.9
0.65
0""")
material_5 = Panel("""GND_GRASS
Rough
0.2
1
1250
1252
0.92
0.75
0""")
material_6 = Panel("""GND_WATER
MediumRough
0.2
1.4
1840
1480
0.95
0.8
0""")
e_executable_path = Panel("C:\openstudio-2.7.0\EnergyPlus\energyplus.exe")
material_7 = Panel("""VEG_GHAF
VeryRough
0.05
0.01
0.5
150
0.9
0.7
0.7""")
material_8 = Panel("""SHD_SOLID
MediumRough
0.102
0.12
320
795
0.9
0.7
0""")
toplayer = Data("EXAMPLE")

# ---- group: CONTEXT BUILDING MASSES
python = GhPythonScript(Refresh=refreshall, MaterialPanel=material)  # -> LayerName, Roughness, Thickness, Conductivity, Density, SpecificHeat, ThermalAbsorptivity, SolarAbsorptivity, Porosity; inputs Refresh: Boolean, MaterialPanel: list
# ---------- python: Python ----------
if Refresh:
    pass

LayerName = str(MaterialPanel[0])
Roughness = str(MaterialPanel[1])
Thickness = float(MaterialPanel[2])
Conductivity = float(MaterialPanel[3])
Density = float(MaterialPanel[4])
SpecificHeat = float(MaterialPanel[5])
ThermalAbsorptivity = float(MaterialPanel[6])
SolarAbsorptivity = float(MaterialPanel[7])
Porosity = float(MaterialPanel[8])
# ---------- end python ----------
cluster = Cluster_3(solarabsorptivity=python.SolarAbsorptivity)
cluster_2 = Cluster_4(toplayer=toplayer, layername=python.LayerName)  # -> brep_2, brepnames_2
epopaquemat = Honeybee_EnergyPlusOpaqueMaterial(
    name=python.LayerName,
    roughness=python.Roughness,
    thickness=python.Thickness,
    conductivity=python.Conductivity,
    density=python.Density,
    specificHeat=python.SpecificHeat,
    thermAbsp=python.ThermalAbsorptivity,
    solAbsp=python.SolarAbsorptivity,
    visAbsp=python.SolarAbsorptivity)  # -> EPMaterial; plug-in component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
debrep = DeconstructBrep(Brep=cluster_2.brep_2)  # -> flatten(Faces), Edges, Vertices
mass2zone = Honeybee_Masses2Zones(zoneMasses=flatten(cluster_2.brep_2), zoneNames=cluster_2.brepnames_2, maxRoofAngle=30, createHBZones=Toggle(True))  # -> readMe, HBZones; plug-in component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
radopaquemat = HoneybeePlus_RadianceOpaqueMaterial(reflect=graft(cluster), spec=0, rough=0)  # -> simplify(material); plug-in component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
epconstruction = Honeybee_EnergyPlusConstruction(name=python.LayerName, layer_1=epopaquemat)  # -> EPConstruction; plug-in component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
lng = ListLength(List=debrep.Faces)
series = Series(Start=0, Step=1, Count=lng)
concat = Concatenate(FragmentA=python.LayerName, FragmentB=series)
setepzonecnstr = Honeybee_SetEPZoneConstruction(
    HBZones=flatten(mass2zone.HBZones),
    wallEPConstruction=epconstruction,
    roofEPConstruction=epconstruction,
    floorEPConstruction=epconstruction,
    expFloorEPConstruction=epconstruction)  # -> simplify(modifiedHBZones); plug-in component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
hbsurface = HoneybeePlus_HoneybeeSurface(geo=debrep.Faces, names=concat, type="0", rad_mat=radopaquemat)  # -> report, flatten(HB_srf); plug-in component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
hbzones_energyplus = Data(flatten(setepzonecnstr))
hb_srfs_radiance = Data(flatten(hbsurface.HB_srf))

# ---- group: GROUND SURFACES
python_2 = GhPythonScript(Refresh=refreshall, MaterialPanel=material_2)  # -> LayerName, Roughness, Thickness, Conductivity, Density, SpecificHeat, ThermalAbsorptivity, SolarAbsorptivity, Porosity; inputs Refresh: Boolean, MaterialPanel: list; same code as python
epopaquemat_2 = Honeybee_EnergyPlusOpaqueMaterial(
    name=python_2.LayerName,
    roughness=python_2.Roughness,
    thickness=python_2.Thickness,
    conductivity=python_2.Conductivity,
    density=python_2.Density,
    specificHeat=python_2.SpecificHeat,
    thermAbsp=python_2.ThermalAbsorptivity,
    solAbsp=python_2.SolarAbsorptivity,
    visAbsp=python_2.SolarAbsorptivity)  # -> EPMaterial; plug-in component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
cluster_3 = Cluster(toplayer=toplayer, layername=python_2.LayerName)  # -> surfaces_2, surfacenames_2
radopaquemat_2 = HoneybeePlus_RadianceOpaqueMaterial(name=graft(python_2.LayerName), reflect=graft(0.35), spec=0, rough=0)  # -> simplify(material); plug-in component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
epconstruction_2 = Honeybee_EnergyPlusConstruction(name=python_2.LayerName, layer_1=epopaquemat_2)  # -> EPConstruction; plug-in component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
createhbsrfs = Honeybee_createHBSrfs(geometry=cluster_3.surfaces_2, srfName=cluster_3.surfacenames_2, srfType="2", EPConstruction=epconstruction_2)  # -> readMe, simplify(flatten(HBSurface)); plug-in component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
hbsurface_2 = HoneybeePlus_HoneybeeSurface(geo=cluster_3.surfaces_2, names=cluster_3.surfacenames_2, type="2", rad_mat=radopaquemat_2)  # -> report, flatten(HB_srf); plug-in component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
hbsrfs_energyplus = Data(flatten(createhbsrfs.HBSurface))
hb_srfs_radiance_2 = Data(flatten(hbsurface_2.HB_srf))

python_3 = GhPythonScript(Refresh=refreshall, MaterialPanel=material_3)  # -> LayerName, Roughness, Thickness, Conductivity, Density, SpecificHeat, ThermalAbsorptivity, SolarAbsorptivity, Porosity; inputs Refresh: Boolean, MaterialPanel: list; same code as python
cluster_4 = Cluster_3(solarabsorptivity=python_3.SolarAbsorptivity)
cluster_5 = Cluster(toplayer=toplayer, layername=python_3.LayerName)  # -> surfaces_2, surfacenames_2
epopaquemat_3 = Honeybee_EnergyPlusOpaqueMaterial(
    name=python_3.LayerName,
    roughness=python_3.Roughness,
    thickness=python_3.Thickness,
    conductivity=python_3.Conductivity,
    density=python_3.Density,
    specificHeat=python_3.SpecificHeat,
    thermAbsp=python_3.ThermalAbsorptivity,
    solAbsp=python_3.SolarAbsorptivity,
    visAbsp=python_3.SolarAbsorptivity)  # -> EPMaterial; plug-in component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
epconstruction_3 = Honeybee_EnergyPlusConstruction(name=python_3.LayerName, layer_1=epopaquemat_3)  # -> EPConstruction; plug-in component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
radopaquemat_3 = HoneybeePlus_RadianceOpaqueMaterial(name=graft(python_3.LayerName), reflect=graft(cluster_4), spec=0, rough=0)  # -> simplify(material); plug-in component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
cluster_6 = Cluster_2(surfaces=cluster_5.surfaces_2)
createhbsrfs_2 = Honeybee_createHBSrfs(geometry=cluster_5.surfaces_2, srfName=cluster_5.surfacenames_2, srfType="1", EPConstruction=epconstruction_3)  # -> readMe, simplify(flatten(HBSurface)); plug-in component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
hbsurface_3 = HoneybeePlus_HoneybeeSurface(geo=cluster_5.surfaces_2, names=cluster_5.surfacenames_2, type="1", rad_mat=radopaquemat_3)  # -> report, flatten(HB_srf); plug-in component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
hbsrfs_energyplus_2 = Data(flatten(createhbsrfs_2.HBSurface))
hb_srfs_radiance_3 = Data(flatten(hbsurface_3.HB_srf))
boundaries = Data(flatten(cluster_6))
reflectivity = Data(flatten(cluster_4))

python_4 = GhPythonScript(Refresh=refreshall, MaterialPanel=material_4)  # -> LayerName, Roughness, Thickness, Conductivity, Density, SpecificHeat, ThermalAbsorptivity, SolarAbsorptivity, Porosity; inputs Refresh: Boolean, MaterialPanel: list; same code as python
cluster_7 = Cluster_3(solarabsorptivity=python_4.SolarAbsorptivity)
cluster_8 = Cluster(toplayer=toplayer, layername=python_4.LayerName)  # -> surfaces_2, surfacenames_2
epopaquemat_4 = Honeybee_EnergyPlusOpaqueMaterial(
    name=python_4.LayerName,
    roughness=python_4.Roughness,
    thickness=python_4.Thickness,
    conductivity=python_4.Conductivity,
    density=python_4.Density,
    specificHeat=python_4.SpecificHeat,
    thermAbsp=python_4.ThermalAbsorptivity,
    solAbsp=python_4.SolarAbsorptivity,
    visAbsp=python_4.SolarAbsorptivity)  # -> EPMaterial; plug-in component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
epconstruction_4 = Honeybee_EnergyPlusConstruction(name=python_4.LayerName, layer_1=epopaquemat_4)  # -> EPConstruction; plug-in component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
radopaquemat_4 = HoneybeePlus_RadianceOpaqueMaterial(name=graft(python_4.LayerName), reflect=graft(cluster_7), spec=0, rough=0)  # -> simplify(material); plug-in component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
cluster_9 = Cluster_2(surfaces=cluster_8.surfaces_2)
createhbsrfs_3 = Honeybee_createHBSrfs(geometry=cluster_8.surfaces_2, srfName=cluster_8.surfacenames_2, srfType="1", EPConstruction=epconstruction_4)  # -> readMe, simplify(flatten(HBSurface)); plug-in component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
hbsurface_4 = HoneybeePlus_HoneybeeSurface(geo=cluster_8.surfaces_2, names=cluster_8.surfacenames_2, type="1", rad_mat=radopaquemat_4)  # -> report, flatten(HB_srf); plug-in component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
hbsrfs_energyplus_3 = Data(flatten(createhbsrfs_3.HBSurface))
hb_srfs_radiance_4 = Data(flatten(hbsurface_4.HB_srf))
boundaries_2 = Data(flatten(cluster_9))
reflectivity_2 = Data(flatten(cluster_7))

python_5 = GhPythonScript(Refresh=refreshall, MaterialPanel=material_6)  # -> LayerName, Roughness, Thickness, Conductivity, Density, SpecificHeat, ThermalAbsorptivity, SolarAbsorptivity, Porosity; inputs Refresh: Boolean, MaterialPanel: list; same code as python
cluster_10 = Cluster_3(solarabsorptivity=python_5.SolarAbsorptivity)
cluster_11 = Cluster(toplayer=toplayer, layername=python_5.LayerName)  # -> surfaces_2, surfacenames_2
epopaquemat_5 = Honeybee_EnergyPlusOpaqueMaterial(
    name=python_5.LayerName,
    roughness=python_5.Roughness,
    thickness=python_5.Thickness,
    conductivity=python_5.Conductivity,
    density=python_5.Density,
    specificHeat=python_5.SpecificHeat,
    thermAbsp=python_5.ThermalAbsorptivity,
    solAbsp=python_5.SolarAbsorptivity,
    visAbsp=python_5.SolarAbsorptivity)  # -> EPMaterial; plug-in component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
epconstruction_5 = Honeybee_EnergyPlusConstruction(name=python_5.LayerName, layer_1=epopaquemat_5)  # -> EPConstruction; plug-in component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
radopaquemat_5 = HoneybeePlus_RadianceOpaqueMaterial(name=graft(python_5.LayerName), reflect=graft(cluster_10), spec=0, rough=0)  # -> simplify(material); plug-in component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
cluster_12 = Cluster_2(surfaces=cluster_11.surfaces_2)
createhbsrfs_4 = Honeybee_createHBSrfs(geometry=cluster_11.surfaces_2, srfName=cluster_11.surfacenames_2, srfType="1", EPConstruction=epconstruction_5)  # -> readMe, simplify(flatten(HBSurface)); plug-in component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
hbsurface_5 = HoneybeePlus_HoneybeeSurface(geo=cluster_11.surfaces_2, names=cluster_11.surfacenames_2, type="1", rad_mat=radopaquemat_5)  # -> report, flatten(HB_srf); plug-in component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
hbsrfs_energyplus_4 = Data(flatten(createhbsrfs_4.HBSurface))
hb_srfs_radiance_5 = Data(flatten(hbsurface_5.HB_srf))
boundaries_3 = Data(flatten(cluster_12))
reflectivity_3 = Data(flatten(cluster_10))

python_6 = GhPythonScript(Refresh=refreshall, MaterialPanel=material_5)  # -> LayerName, Roughness, Thickness, Conductivity, Density, SpecificHeat, ThermalAbsorptivity, SolarAbsorptivity, Porosity; inputs Refresh: Boolean, MaterialPanel: list; same code as python
cluster_13 = Cluster_3(solarabsorptivity=python_6.SolarAbsorptivity)
cluster_14 = Cluster(toplayer=toplayer, layername=python_6.LayerName)  # -> surfaces_2, surfacenames_2
epopaquemat_6 = Honeybee_EnergyPlusOpaqueMaterial(
    name=python_6.LayerName,
    roughness=python_6.Roughness,
    thickness=python_6.Thickness,
    conductivity=python_6.Conductivity,
    density=python_6.Density,
    specificHeat=python_6.SpecificHeat,
    thermAbsp=python_6.ThermalAbsorptivity,
    solAbsp=python_6.SolarAbsorptivity,
    visAbsp=python_6.SolarAbsorptivity)  # -> EPMaterial; plug-in component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
epconstruction_6 = Honeybee_EnergyPlusConstruction(name=python_6.LayerName, layer_1=epopaquemat_6)  # -> EPConstruction; plug-in component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
radopaquemat_6 = HoneybeePlus_RadianceOpaqueMaterial(name=graft(python_6.LayerName), reflect=graft(cluster_13), spec=0, rough=0)  # -> simplify(material); plug-in component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
cluster_15 = Cluster_2(surfaces=cluster_14.surfaces_2)
createhbsrfs_5 = Honeybee_createHBSrfs(geometry=cluster_14.surfaces_2, srfName=cluster_14.surfacenames_2, srfType="1", EPConstruction=epconstruction_6)  # -> readMe, simplify(flatten(HBSurface)); plug-in component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
hbsurface_6 = HoneybeePlus_HoneybeeSurface(geo=cluster_14.surfaces_2, names=cluster_14.surfacenames_2, type="1", rad_mat=radopaquemat_6)  # -> report, flatten(HB_srf); plug-in component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
hbsrfs_energyplus_5 = Data(flatten(createhbsrfs_5.HBSurface))
hb_srfs_radiance_6 = Data(flatten(hbsurface_6.HB_srf))
boundaries_4 = Data(flatten(cluster_15))
reflectivity_4 = Data(flatten(cluster_13))

# ---- group: SHADING SURFACES
python_7 = GhPythonScript(Refresh=refreshall, MaterialPanel=material_7)  # -> LayerName, Roughness, Thickness, Conductivity, Density, SpecificHeat, ThermalAbsorptivity, SolarAbsorptivity, Porosity; inputs Refresh: Boolean, MaterialPanel: list; same code as python
constantschedule = Honeybee_ConstantSchedule(value=python_7.Porosity, scheduleName=python_7.LayerName)  # -> readMe, schedule, weekSched, schedIDFText; plug-in component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
radglassmaterial = Honeybee_RadianceGlassMaterial(
    materialName=python_7.LayerName,
    RTransmittance=python_7.Porosity,
    GTransmittance=python_7.Porosity,
    BTransmittance=python_7.Porosity,
    refractiveIndex=1.52)  # -> avrgTrans, RADMaterial; plug-in component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
cluster_16 = Cluster(toplayer=toplayer, layername=python_7.LayerName)  # -> surfaces_2, surfacenames_2
radglassmat = HoneybeePlus_RadianceGlassMaterial(name=python_7.LayerName, t_vis=python_7.Porosity)  # -> material; plug-in component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
hb_epcontextsrf = HoneybeeEPContextSurfaces(
    shdSurfaces=flatten(cluster_16.surfaces_2),
    EPTransSchedule=constantschedule.schedule,
    RADMaterial=radglassmaterial.RADMaterial)  # -> HBContext; inputs shdSurfaces: list of Brep, justBoundingBox: Boolean
# ---------- hb_epcontextsrf: Python ----------
"""
prepare shading/context geometries

    Args:
        northVectorOrRotation: A vector that shows North or a number that shows
                               the rotation of the North from the Y axis
        bldgMasses: List of closed Breps as thermal zones.
    Returns:
        report: ...
        thermalZones: Thermal zone's geometries for visualiza
"""

ghenv.Component.Name = 'Honeybee EP context Surfaces'
ghenv.Component.NickName = 'HB_EPContextSrf'
ghenv.Component.Message = 'VER 0.0.64\nNOV_20_2018'
ghenv.Component.IconDisplayMode = ghenv.Component.IconDisplayMode.application
ghenv.Component.Category = "Honeybee"
ghenv.Component.SubCategory = "10 | Energy | Energy"
#compatibleHBVersion = VER 0.0.57\nNOV_04_2016
#compatibleLBVersion = VER 0.0.59\nFEB_01_2015
ghenv.Component.AdditionalHelpFromDocStrings = "2"

import rhinoscriptsyntax as rs
import Rhino as rc
import scriptcontext as sc
import os
import System
import Grasshopper.Kernel as gh
import uuid

tolerance = sc.doc.ModelAbsoluteTolerance
import math


def main(shdSurfaces, EPTransSchedule, meshingSettings, justBoundingBox):
    
    # import the classes
    if sc.sticky.has_key('honeybee_release'):

        try:
            if not sc.sticky['honeybee_release'].isCompatible(ghenv.Component): return -1
            if sc.sticky['honeybee_release'].isInputMissing(ghenv.Component): return -1
        except:
            warning = "You need a newer version of Honeybee to use this compoent." + \
            " Use updateHoneybee component to update userObjects.\n" + \
            "If you have already updated userObjects drag Honeybee_Honeybee component " + \
            "into canvas and try again."
            w = gh.GH_RuntimeMessageLevel.Warning
            ghenv.Component.AddRuntimeMessage(w, warning)
            return -1
        
        # don't customize this part
        hb_EPSrf = sc.sticky["honeybee_EPSurface"]
        hb_EPSHDSurface = sc.sticky["honeybee_EPShdSurface"]
        hb_RADMaterialAUX = sc.sticky["honeybee_RADMaterialAUX"]
        hb_EPObjectsAux = sc.sticky["honeybee_EPObjectsAUX"]()
        HBScheduleList = sc.sticky["honeybee_ScheduleLib"].keys()

        ########################################################################
        #----------------------------------------------------------------------#
        shdBreps = []
        # create bounding box of shading geometries
        if justBoundingBox:
            for brep in shdSurfaces:
                if brep.Faces.Count>1 or not brep.Faces[0].IsPlanar(sc.doc.ModelAbsoluteTolerance):
                    shdBreps.append(brep.GetBoundingBox(True).ToBrep())
                else:
                    shdBreps.append(brep)
        else:
            shdBreps = shdSurfaces
        
        shadingClasses = []
        shadingMeshPreview = []
        
        if meshingSettings == None:
            mp = rc.Geometry.MeshingParameters.Minimal
            mp.SimplePlanes = True
        else:
            mp = meshingSettings
        
        def getRadMaterialName(radMaterial):
            nameStr = radMaterial.split(" ")[2]
            name =  nameStr.split("\n")[0]
            return name
        
        for brepCount, brep in enumerate(shdBreps):
            if brep != None:
                isPlanar = True
                # check planarity
                for face in brep.Faces:
                    if not face.IsPlanar(tolerance):
                        isPlanar = False
                        break
                
                shadingBreps = []
                if not isPlanar:
                    meshArray = rc.Geometry.Mesh.CreateFromBrep(brep, mp)
                    for mesh in meshArray:
                        for meshFace in range(mesh.Faces.Count):
                            vertices = list(mesh.Faces.GetFaceVertices(meshFace))[1:]
                            vertices = vertices + [sc.doc.ModelAbsoluteTolerance]
                            # create the brep from mesh
                            shdBrep = rc.Geometry.Brep.CreateFromCornerPoints(*vertices)
                            shadingBreps.append(shdBrep)
                else:
                    for face in brep.Faces:
                        shadingBreps.append(face.DuplicateFace(False))
                
                for faceCount, shdBrep in enumerate(shadingBreps):
                        thisShading = hb_EPSHDSurface(shdBrep, 1000*brepCount + faceCount, 'shdSrf_' + `brepCount` + '_' + `faceCount` + "_" + str(uuid.uuid4()))
                        
                        # add transmittance schedule if any
                        if EPTransSchedule!=None:
                            schedule= EPTransSchedule.upper()
                            if schedule!=None and not schedule.lower().endswith(".csv") and schedule not in HBScheduleList:
                                msg = "Cannot find " + schedule + " in Honeybee schedule library."
                                print msg
                                ghenv.Component.AddRuntimeMessage(gh.GH_RuntimeMessageLevel.Warning, msg)
                                return -1
                            elif schedule!=None and schedule.lower().endswith(".csv"):
                                # check if csv file is existed
                                if not os.path.isfile(schedule):
                                    msg = "Cannot find the shchedule file: " + schedule
                                    print msg
                                    ghenv.Component.AddRuntimeMessage(gh.GH_RuntimeMessageLevel.Warning, msg)
                                    return -1
                            
                            thisShading.TransmittanceSCH = schedule
                        
                        # add the Rad Material if any
                        if RADMaterial!=None:
                            # if it is just the name of the material make sure it is already defined
                            if len(RADMaterial.split(" ")) == 1:
                                # if the material is not in the library add it to the library
                                if not hb_RADMaterialAUX.isMatrialExistInLibrary(RADMaterial):
                                    warningMsg = "Can't find " + RADMaterial + " in RAD Material Library.\n" + \
                                                "Add the material to the library and try again."
                                    ghenv.Component.AddRuntimeMessage(gh.GH_RuntimeMessageLevel.Warning, warningMsg)
                                    return
                                
                                try:
                                    thisShading.setRADMaterial(RADMaterial)
                                except Exception, e:
                                    print e
                                    warningMsg = "You are using an old version of Honeybee_Honeybee! Update your files and try again."
                                    print warningMsg
                                    ghenv.Component.AddRuntimeMessage(gh.GH_RuntimeMessageLevel.Warning, warningMsg)
                                    return
                                
                                addedToLib = True
                            else:
                                
                                # try to add the material to the library
                                addedToLib, thisShading.RadMaterial = hb_RADMaterialAUX.analyseRadMaterials(RADMaterial, True)
                                
                            if addedToLib==False:
                                warningMsg = "Failed to add " + RADMaterial + " to the Library."
                                ghenv.Component.AddRuntimeMessage(gh.GH_RuntimeMessageLevel.Warning, warningMsg)
                                return
                        
                        # add shading to the list
                        shadingClasses.append(thisShading)
                
        # add to the hive
        hb_hive = sc.sticky["honeybee_Hive"]()
        HBContext  = hb_hive.addToHoneybeeHive(shadingClasses, ghenv.Component)
        return HBContext
        ################################################################################################
    else:
        print "You should first let Honeybee to fly..."
        w = gh.GH_RuntimeMessageLevel.Warning
        ghenv.Component.AddRuntimeMessage(w, "You should first let Honeybee to fly...")
        return -1
        

if _shdSurfaces and _shdSurfaces[0]!=None:
    # add cleaning function
    result= main(_shdSurfaces, EPTransSchedule_, meshingSettings_, justBoundingBox_)
    
    if result != -1: HBContext = result
# ---------- end hb_epcontextsrf ----------
hbsurface_7 = HoneybeePlus_HoneybeeSurface(geo=cluster_16.surfaces_2, type="6", rad_mat=radglassmat)  # -> report, flatten(HB_srf); plug-in component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
hbcontextsrfs_energyplus = Data(flatten(hb_epcontextsrf))
hb_srfs_radiance_7 = Data(flatten(hbsurface_7.HB_srf))

python_8 = GhPythonScript(Refresh=refreshall, MaterialPanel=material_8)  # -> LayerName, Roughness, Thickness, Conductivity, Density, SpecificHeat, ThermalAbsorptivity, SolarAbsorptivity, Porosity; inputs Refresh: Boolean, MaterialPanel: list; same code as python
constantschedule_2 = Honeybee_ConstantSchedule(value=python_8.Porosity, scheduleName=python_8.LayerName)  # -> readMe, schedule, weekSched, schedIDFText; plug-in component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
radglassmaterial_2 = Honeybee_RadianceGlassMaterial(
    materialName=python_8.LayerName,
    RTransmittance=python_8.Porosity,
    GTransmittance=python_8.Porosity,
    BTransmittance=python_8.Porosity,
    refractiveIndex=1.52)  # -> avrgTrans, RADMaterial; plug-in component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
cluster_17 = Cluster(toplayer=toplayer, layername=python_8.LayerName)  # -> surfaces_2, surfacenames_2
radglassmat_2 = HoneybeePlus_RadianceGlassMaterial(name=python_8.LayerName, t_vis=python_8.Porosity)  # -> material; plug-in component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
hb_epcontextsrf_2 = HoneybeeEPContextSurfaces(
    shdSurfaces=flatten(cluster_17.surfaces_2),
    EPTransSchedule=constantschedule_2.schedule,
    RADMaterial=radglassmaterial_2.RADMaterial)  # -> HBContext; inputs shdSurfaces: list of Brep, justBoundingBox: Boolean; same code as hb_epcontextsrf
hbsurface_8 = HoneybeePlus_HoneybeeSurface(geo=cluster_17.surfaces_2, type="6", rad_mat=radglassmat_2)  # -> report, flatten(HB_srf); plug-in component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
hbcontextsrfs_energyplus_2 = Data(flatten(hb_epcontextsrf_2))
hb_srfs_radiance_8 = Data(flatten(hbsurface_8.HB_srf))

# ----
ghpython_script = GhPythonScript(refesh=refreshall, casename=toplayer)  # -> casename; inputs refesh: Boolean
# ---------- ghpython_script: Python ----------
casename = _casename
# ---------- end ghpython_script ----------

# ---- group: ANALYSIS POINTS
concat_2 = Concatenate(FragmentA=ghpython_script, FragmentC="::", FragmentB="ANALYSIS_REGION")
concat_3 = Concatenate(FragmentA=ghpython_script, FragmentC="::", FragmentB="ANALYSIS_PLANE")
dpipeline = DynamicGeometryPipeline(
    LayerFilter=concat_2,
    TypeFilter="Brep",
    NameFilter="*",
    GroupByLayer=False,
    GroupByType=False,
    IncludeHidden=True,
    IncludeLocked=True,
    enableFullPath=True,
    listenToAttributes=True)  # -> simplify(GeometryOut)
dpipeline_2 = DynamicGeometryPipeline(
    LayerFilter=concat_3,
    TypeFilter="Brep",
    NameFilter="*",
    GroupByLayer=False,
    GroupByType=False,
    IncludeHidden=True,
    IncludeLocked=True,
    enableFullPath=True,
    listenToAttributes=True)  # -> simplify(GeometryOut)
edges = BrepEdges(Brep=dpipeline)  # -> Naked, Interior, NonManifold
Z = UnitZ(Factor="100")
move = Move(Geometry=dpipeline, Motion=Z)  # -> Geometry, Transform
join = JoinCurves(Curves=edges.Naked, Preserve=False)
cp = ControlPoints(Curve=join)  # -> flatten(Points), Weights, Knots
genpts = Ladybug_GeneratePointGrid(geometry=move.Geometry, grid_size="10", dist_surface="0")  # -> flatten(points), flatten(vectors), flatten(face_areas), mesh; plug-in component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
lng_2 = ListLength(List=cp.Points)
subtraction = Subtraction(A=lng_2, B="1")
project = ProjectPoint(Point=genpts.points, Direction=Vector(0, 0, -1), Geometry=dpipeline_2)  # -> Point, Index
split = SplitList(List=cp.Points, Index=subtraction)  # -> ListA, ListB
analysisregionboundaryvertices = Point(flatten(split.ListA))
analysispoints = Point(flatten(project.Point))

# ---- group: ANALYSIS POINT GROUND REFLECTIVITIES
entwine_reflectivities = Entwine(Branch00=reflectivity, Branch01=reflectivity_2, Branch02=reflectivity_4, Branch04=reflectivity_3, FlattenInputs=True)  # -> simplify(Result)
entwine_boundaries = Entwine(Branch00=boundaries, Branch01=boundaries_2, Branch02=boundaries_4, Branch04=boundaries_3, FlattenInputs=True)  # -> simplify(Result)
null = NullItem(Item=entwine_boundaries)  # -> NullFlags, InvalidFlags, Description
toggle = BooleanToggle(True)
ma = MassAddition(Input=null.InvalidFlags)  # -> flatten(Result), PartialResults
cull = CullPattern(List=entwine_boundaries, CullPattern=invert(null.InvalidFlags))
equals = Equality(FirstNumber="0", SecondNumber=ma.Result)  # -> Equality, Inequality
clean = CleanTree(RemoveNulls=toggle, RemoveInvalid=toggle, RemoveEmpty=toggle, Tree=cull)
dispatch = Dispatch(List=entwine_reflectivities, DispatchPattern=flatten(equals.Equality))  # -> ListA, ListB
project_2 = Project(Geometry=clean, Plane=PlaneXY(0, 0, 0))  # -> Geometry, Transform
incurve = PointInCurve(Point=analysispoints, Curve=graft(project_2.Geometry))  # -> simplify(Relationship), Point
lng_3 = ListLength(List=project_2.Geometry)  # -> flatten(Length)
dup = DuplicateData(Data=graft(dispatch.ListA), Number=graft(lng_3), Order=True)  # -> flatten(Data)
larger = LargerThan(FirstNumber=incurve.Relationship, SecondNumber="1")  # -> LargerThan, OrEqualTo
dispatch_2 = Dispatch(List=analysispoints, DispatchPattern=larger.OrEqualTo)  # -> simplify(ListA), ListB
lng_4 = ListLength(List=simplify(dispatch_2.ListA))
dup_2 = DuplicateData(Data=simplify(graft(dup)), Number=simplify(graft(lng_4)), Order=True)
point_ground_reflectivities = Data(flatten(dup_2))
analysispoints_2 = Point(flatten(dispatch_2.ListA))

# ---- group: COMBINE GEOMETRIES
merge_groundhbsurfaces = Merge(
    Data1=hbsrfs_energyplus_2,
    Data2=hbsrfs_energyplus_3,
    Data3=hbsrfs_energyplus_5,
    Data4=hbsrfs_energyplus_4,
    Data5=hbsrfs_energyplus)  # -> flatten(Result)
merge_hbcontext = Merge(Data1=hbcontextsrfs_energyplus_2, Data2=hbcontextsrfs_energyplus)  # -> flatten(Result)
merge_hb_srfs = Merge(
    Data1=hb_srfs_radiance,
    Data2=hb_srfs_radiance_3,
    Data3=hb_srfs_radiance_4,
    Data4=hb_srfs_radiance_6,
    Data5=hb_srfs_radiance_5,
    Data6=hb_srfs_radiance_8,
    Data7=hb_srfs_radiance_7,
    Data8=hb_srfs_radiance_2)  # -> flatten(Result)
toggle_2 = BooleanToggle(True)
toggle_3 = BooleanToggle(True)
toggle_4 = BooleanToggle(True)
clean_2 = CleanTree(RemoveNulls=toggle_2, RemoveInvalid=toggle_2, RemoveEmpty=toggle_2, Tree=merge_hb_srfs)
clean_3 = CleanTree(RemoveNulls=toggle_4, RemoveInvalid=toggle_4, RemoveEmpty=toggle_4, Tree=merge_hbcontext)
clean_4 = CleanTree(RemoveNulls=toggle_3, RemoveInvalid=toggle_3, RemoveEmpty=toggle_3, Tree=merge_groundhbsurfaces)
createhbzones = Honeybee_createHBZones(name="GROUND_ZONE", HBSurfaces=flatten(clean_4), isConditioned=Toggle(False))  # -> readMe, HBZone; plug-in component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
merge_hbzones = Merge(Data1=hbzones_energyplus, Data2=createhbzones.HBZone)  # -> flatten(Result)
hbzones = Data(flatten(merge_hbzones))
hbcontext = Data(flatten(clean_3))
hb_srfs = Data(flatten(clean_2))

# ----
toggle_5 = BooleanToggle(True)
runradiancefilegeneration = Boolean(toggle_5)
runeplusfilegeneration = Boolean(toggle_5)

# ---- group: Generate EnergyPlus surface temperature model
toggle_6 = BooleanToggle(False)
simcontrol = Honeybee_SimulationControl(
    doZoneSizingCalculation=toggle_6,
    doSystemSizingCalculation=toggle_6,
    doPlantSizingCalculation=toggle_6,
    runSimForSizingPeriods=toggle_6,
    runSimForRunPeriods=Toggle(True))  # -> simControls; plug-in component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
importgroundtemp = Ladybug_ImportGroundTemp(epwFile=weatherfile)  # -> readMe, groundtemp1st, groundtemp2nd, groundtemp3rd, profileCrvs, crvColors, graphAxes, graphtext, Legend; plug-in component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
shadowpar = Honeybee_ShadowPar(calculationMethod="TimestepFrequency", frequency="1", maximumFigure="1000")  # -> shadowPar; plug-in component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
panel = Panel("""OutputControl:Table:Style,Comma;
Output:Variable,*,Surface Outside Face Temperature, hourly;
Output:Diagnostics,DisplayExtraWarnings;""")
strnum = Ladybug_SeparateData(inputList=flatten(importgroundtemp.groundtemp1st))  # -> numbers, strings; plug-in component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
energysimpar = Honeybee_EnergySimulationPar(
    timestep=6,
    shadowCalcPar=shadowpar,
    solarDistribution="3",
    simulationControls=simcontrol,
    terrain="0",
    monthlyGrndTemps=strnum.numbers)  # -> energySimPar; plug-in component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
exporttoopenstudio = Honeybee_ExportToOpenStudio(
    epwWeatherFile=weatherfile,
    energySimPar=energysimpar,
    HBZones=flatten(hbzones),
    HBContext=flatten(hbcontext),
    simulationOutputs=flatten(panel),
    writeOSM=runeplusfilegeneration,
    runSimulation="3",
    fileName=toplayer,
    workingDir=output_directory)  # -> readMe, osmFileAddress, idfFileAddress, resultFileAddress, eioFileAddress, rddFileAddress, htmlReport, studyFolder, model; plug-in component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
modifygrass_underground = GhPythonScript(originalFile=exporttoopenstudio.idfFileAddress, rewrite=Toggle(True))  # -> idfAddress; inputs rewrite: Boolean
# ---------- modifygrass_underground: Python ----------
import os, re

# Read original file
with open(_originalFile, "r") as f:
    data = f.read()

# Replace whitespace between values and comments
test = re.sub("\s+!", "!", data)

# Replace grass material
test = re.sub(
    "Material,\n  GND_GRASS,!- Name\n  Rough,!- Roughness\n  0.2,!- Thickness {m}\n  1,!- Conductivity {W/m-K}\n  1250,!- Density {kg/m3}\n  1252,!- Specific Heat {J/kg-K}\n  0.92,!- Thermal Absorptance\n  0.75,!- Solar Absorptance\n  0.7;!- Visible Absorptance", 
    "Material:RoofVegetation,\n  GND_GRASS,!- Name\n  0.05,!- Height of Plants\n  1.71,!- Leaf Area Index\n  0.19,!- Leaf Reflectivity\n  0.95,!- Leaf Emissivity\n  180,!- Minimum Stomatal Resistance\n  Soil,!- Soil Layer Name\n  Rough,!- Roughness\n  0.2,!- Thickness\n  1,!- Conductivity of Dry Soil\n  1250,!- Density of Dry Soil\n  1252,!- Specific Heat of Dry Soil\n  0.92,!- Thermal Absorptance\n  0.75,!- Solar Absorptance\n  0.75,!- Visible Absorptance\n  0.3,!- Saturation Volumetric Moisture Content of the Soil Layer\n  0.01,!- Residual Volumetric Moisture Content of the Soil Layer\n  0.1,!- Initial Volumetric Moisture Content of the Soil Layer\n  Simple;!- Moisture Diffusion Calculation Method", 
    test
)

# Make underground surfaces ground-adjacent
test = re.sub(
    "  GND_SURROUNDING,!- Construction Name\n  GROUND_ZONE,!- Zone Name\n  Outdoors,!- Outside Boundary Condition\n  ,!- Outside Boundary Condition Object\n  Nosun,!- Sun Exposure\n  Nowind,!- Wind Exposure", 
    "  GND_SURROUNDING,!- Construction Name\n  GROUND_ZONE,!- Zone Name\n  Ground,!- Outside Boundary Condition\n  ,!- Outside Boundary Condition Object\n  Nosun,!- Sun Exposure\n  Nowind,!- Wind Exposure", 
    test
)
test = re.sub(
    "  GND_SURROUNDING,!- Construction Name\n  GROUND_ZONE,!- Zone Name\n  Outdoors,!- Outside Boundary Condition\n  ,!- Outside Boundary Condition Object\n  Sunexposed,!- Sun Exposure\n  Windexposed,!- Wind Exposure", 
    "  GND_SURROUNDING,!- Construction Name\n  GROUND_ZONE,!- Zone Name\n  Ground,!- Outside Boundary Condition\n  ,!- Outside Boundary Condition Object\n  Nosun,!- Sun Exposure\n  Nowind,!- Wind Exposure", 
    test
)

# Rewrite the IDF file
if _rewrite:
    with open(_originalFile, "w") as f:
        f.write(test)
    idfAddress = _originalFile
# ---------- end modifygrass_underground ----------
createbat = GhPythonScript(epwPath=weatherfile, eplusPath=e_executable_path, idfPath=modifygrass_underground)  # -> command
# ---------- createbat: Python ----------
import rhinoscriptsyntax as rs
import os, json

# Create EnergyPlus run command
#idf_path = os.path.join(_outputDir, _caseName, "OpenStudio", _caseName, "ModelToIdf", "in.idf").replace("\\", "/")
#idf_output_dir = os.path.join(_outputDir, _caseName, "OpenStudio", _caseName, "ModelToIdf").replace("\\", "/")
#eplus_output_path = os.path.join(_outputDir, _caseName, "OpenStudio", _caseName, "ModelToIdf", "eplusout.csv").replace("\\", "/")
#eplus_command = '"{0:}" -a -r -x -d "{3:}" -w "{1:}" "{2:}"'.format(_eplusPath.replace("\\", "/"), _epwFile, idf_path, idf_output_dir)

# Base path for batch file
bat_dir = os.path.dirname(os.path.dirname(os.path.dirname(os.path.dirname(_idfPath))))
_batPath = os.path.join(bat_dir, "run_eplus.bat")

# Output directory for eplus run
eplus_out_dir = os.path.dirname(_idfPath)

# Command string to write to BAT
eplus_command = '"{0:}" -a -r -x -d "{3:}" -w "{1:}" "{2:}"'.format(_eplusPath, _epwPath, _idfPath, eplus_out_dir).replace("\\", "/")

# Write BAT file
with open(_batPath, "w") as f:
    f.write(eplus_command)

command = eplus_command
# ---------- end createbat ----------

# ---- group: TESTING GROUP FOR DODGY GEOMETRY!
# TEST SPACE FOR DODGY GROUND GEOMETRY
# - Enable to check model validity!
toggle_7 = BooleanToggle(True)  # disabled
panel_2 = Panel("AverageOverDaysInFrequency")  # disabled
toggle_8 = BooleanToggle(False)  # disabled
panel_3 = Panel("365")  # disabled
panel_4 = Panel("200")  # disabled
simcontrol_2 = Honeybee_SimulationControl(
    doZoneSizingCalculation=toggle_8,
    doSystemSizingCalculation=toggle_8,
    doPlantSizingCalculation=toggle_8,
    runSimForSizingPeriods=toggle_8,
    runSimForRunPeriods=toggle_7)  # -> simControls; disabled; plug-in component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
importgroundtemp_2 = Ladybug_ImportGroundTemp(epwFile=weatherfile)  # -> readMe, groundtemp1st, groundtemp2nd, groundtemp3rd, profileCrvs, crvColors, graphAxes, graphtext, Legend; disabled; plug-in component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
shadowpar_2 = Honeybee_ShadowPar(calculationMethod=panel_2, frequency=panel_3, maximumFigure=panel_4)  # -> shadowPar; disabled; plug-in component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
isconvex = Honeybee_FindNonConvex(breps=hbzones)  # -> readMe, nonConvex, faultyGeometry; disabled; plug-in component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
panel_5 = Panel("""OutputControl:Table:Style,Comma;
Output:Variable,*,Site Outdoor Air Drybulb Temperature, hourly;
Output:Diagnostics,DisplayExtraWarnings;""")  # disabled
strnum_2 = Ladybug_SeparateData(inputList=flatten(importgroundtemp_2.groundtemp1st))  # -> numbers, strings; disabled; plug-in component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
panel_6 = Panel("0")  # disabled
panel_7 = Panel("4")  # disabled
panel_8 = Panel("0")  # disabled
panel_9 = Panel("Output:Diagnostics,DisplayExtraWarnings;")  # disabled
panel_10 = Panel("5")  # disabled
panel_11 = Panel("19")  # disabled
panel_12 = Panel("12")  # disabled
energysimpar_2 = Honeybee_EnergySimulationPar(
    timestep=panel_7,
    shadowCalcPar=shadowpar_2,
    solarDistribution=panel_6,
    simulationControls=simcontrol_2,
    terrain=panel_8,
    monthlyGrndTemps=strnum_2.numbers)  # -> energySimPar; disabled; plug-in component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
analysisperiod = Ladybug_AnalysisPeriod(fromMonth=panel_10, fromDay=panel_12, toMonth=panel_10, toDay=panel_11)  # -> readMe, analysisPeriod; disabled; plug-in component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
toggle_9 = BooleanToggle(True)  # disabled
exporttoopenstudio_2 = Honeybee_ExportToOpenStudio(
    epwWeatherFile=weatherfile,
    analysisPeriod=analysisperiod.analysisPeriod,
    energySimPar=energysimpar_2,
    HBZones=flatten(hbzones),
    HBContext=flatten(hbcontext),
    simulationOutputs=flatten(panel_5),
    additionalStrings=flatten(panel_9),
    writeOSM=toggle_9,
    runSimulation=toggle_9)  # -> readMe, osmFileAddress, idfFileAddress, resultFileAddress, eioFileAddress, rddFileAddress, htmlReport, studyFolder, model; disabled; plug-in component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

# ---- group: CREATE RADIANCE CASE
wea = HoneybeePlus_WEAFromEPW(epw_file=weatherfile)  # -> wea; plug-in component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
analysisgrid = HoneybeePlus_AnalysisGrid(test_points=analysispoints_2)  # -> analysis_grid; plug-in component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
skymatrix = HoneybeePlus_SkyMatrix(north=0, wea=wea, density=1)  # -> skymtx; plug-in component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
annualdlrecipe = HoneybeePlus_AnnualDaylightRecipe(skymtx=skymatrix, analysis_grids=analysisgrid, analysis_type="1", reuse_dmtx=Toggle(True))  # -> analysis_recipe; plug-in component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
runradiance = HoneybeePlus_RunRadianceAnalysis(
    analysis_recipe=annualdlrecipe,
    HB_objects=flatten(hb_srfs),
    folder=output_directory,
    name=toplayer,
    write=runradiancefilegeneration)  # -> report, outputs; plug-in component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
createbat_2 = GhPythonScript(HB_report=runradiance.report)  # -> command; inputs HB_report: list
# ---------- createbat_2: Python ----------
import os

# Base path for batch file
base_path = os.path.dirname(HB_report[3].replace("Writing recipe contents to: ", ""))
_batPath = os.path.join(base_path, "run_radiance.bat")
ref_bat_path = os.path.join(base_path, "gridbased_annual", "commands.bat")

# Write BAT file
with open(_batPath, "w") as f:
    f.write(ref_bat_path)

command = ref_bat_path
# ---------- end createbat_2 ----------

# ----
logicpause = GhPythonScript(x=createbat, y=createbat_2)  # -> a, b
# ---------- logicpause: Python ----------
a = 1
b = "Verdana"
# ---------- end logicpause ----------
hbzones_2 = Data(hbzones)
labelzones = Honeybee_LabelZones(HBZones=flatten(hbzones_2), attribute="name", font=logicpause.b)  # -> zoneTxtLabels, labelBasePts, brepTxtLabels, zoneWireFrames; plug-in component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
tsort = SortText(Keys=labelzones.zoneTxtLabels, Values=hbzones_2, Culture=127)  # -> Keys, Values
debrep_2 = DeconstructBrep(Brep=tsort.Values)  # -> flatten(Faces), Edges, Vertices
skypatchdensity = Panel("1")
lng_5 = ListLength(List=debrep_2.Faces)
srfviewfactors = Ladybug_SurfaceViewAnalysis(
    testPtsOrPlanes=flatten(analysispoints_2),
    testSrfs=debrep_2.Faces,
    context=hbcontext,
    viewResolution=skypatchdensity,
    parallel=Toggle(True),
    runIt=Toggle(True))  # -> readMe, srfViewFactors, viewVecSrfIndex, viewVectors, viewPatches, viewPatchBasePt; disabled; plug-in component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
shadingmask = Ladybug_ShadingMask(centerPtOrPlane=analysispoints_2, context=hbcontext, scale=logicpause.a)  # -> contextMask, orientationMask, strategyMask, skyMask, port, contextExposure, orientExposure, strategyExposure, skyExposure; disabled; plug-in component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
split_2 = SplitList(List=srfviewfactors.srfViewFactors, Index=lng_5)  # -> simplify(ListA), simplify(ListB)
surface_view_factors = Data(split_2.ListA)
ptskyexposure = Data(shadingmask.skyExposure)

createbat_recipe = GhPythonScript(
    epwFile=weatherfile,
    outputDir=output_directory,
    caseName=toplayer,
    samplePoints=analysispoints_2,
    boundaryPoints=analysisregionboundaryvertices,
    groundReflectivities=point_ground_reflectivities,
    skyViewFactors=ptskyexposure,
    srfViewFactors=surface_view_factors)  # inputs samplePoints: list of Point3d, boundaryPoints: list of Point3d, groundReflectivities: list, skyViewFactors: list, srfViewFactors: tree; disabled
# ---------- createbat_recipe: Python ----------
__author__ = "tgerrish"
__version__ = "2020.03.17"

import rhinoscriptsyntax as rs
import os, json

# Copy epw file to local directory
os.system('copy {0:} {1:}'.format(_epwFile, os.path.join(_outputDir, _caseName, os.path.basename(_epwFile))))

# Define Radiance result directory
radiance_result_directory = os.path.join(_outputDir, _caseName, "gridbased_annual", "result").replace("\\", "/")

# Generate the JSON recipe for processing in pure Python
d = {}

# EPW file
d["epw"] = os.path.join(_outputDir, _caseName, os.path.basename(_epwFile)).replace("\\", "/")

# Add surface view factors
d["surface_view_factors"] = [[j for j in _srfViewFactors.Branch(i)] for i in range(_srfViewFactors.BranchCount)]

# Add sky view factors
d["sky_view_factors"] = _skyViewFactors

# Add ground reflectivieis
d["ground_reflectivities"] = _groundReflectivities

# Path to radiance results
d["radiation_results"] = radiance_result_directory

# XYZ locations
d["points"] = [[i.X, i.Y, i.Z] for i in _samplePoints]

# Boundary points
d["boundary"] = [[i.X, i.Y, i.Z] for i in _boundaryPoints]

# Energyplus surface temperatures
d["eplus_results"] = os.path.join(_outputDir, _caseName, "OpenStudio", _caseName, "ModelToIdf", "eplusout.csv").replace("\\", "/")

# Output recipe
if (len(_skyViewFactors) != 0) & (_srfViewFactors.BranchCount != 0):
    output_path = os.path.join(_outputDir, _caseName, "recipe.json").replace("\\", "/")
    with open(output_path, "w") as f:
        json.dump(d, f)
# ---------- end createbat_recipe ----------

# ==== cluster Cluster
layername = ClusterInput()
toplayer = ClusterInput()
layername_2 = Data(layername)
toplayer_2 = Data(toplayer)
concat = Concatenate(FragmentA=toplayer_2, FragmentC="::", FragmentB=layername_2)
dpipeline = DynamicGeometryPipeline(
    LayerFilter=concat,
    TypeFilter="Brep",
    NameFilter="*",
    GroupByLayer=False,
    GroupByType=False,
    IncludeHidden=True,
    IncludeLocked=True,
    enableFullPath=True,
    listenToAttributes=True)  # -> simplify(flatten(GeometryOut))
debrep = DeconstructBrep(Brep=dpipeline)  # -> flatten(Faces), Edges, Vertices
lng = ListLength(List=debrep.Faces)
series = Series(Start=0, Step=1, Count=lng)
concat_2 = Concatenate(FragmentA=layername_2, FragmentB=series)
surfacenames = Data(concat_2)
surfaces = Surface(debrep.Faces)
surfacenames_2 = ClusterOutput(surfacenames)
surfaces_2 = ClusterOutput(surfaces)

# ==== cluster Cluster_2
surfaces = ClusterInput()
surfaces_2 = Surface(surfaces)
project = Project(Geometry=surfaces_2, Plane=PlaneXY(0, 0, 0))  # -> Geometry, Transform
area = Area(Geometry=project.Geometry)  # -> Area, Centroid
smaller = SmallerThan(FirstNumber=area.Area, SecondNumber="0.0001")  # -> SmallerThan, OrEqualTo
dispatch = Dispatch(List=surfaces_2, DispatchPattern=smaller.SmallerThan)  # -> ListA, ListB
edges = BrepEdges(Brep=dispatch.ListB)  # -> Naked, Interior, NonManifold
join = JoinCurves(Curves=edges.Naked, Preserve=False)
explode = Explode(Curve=join, Recursive=True)  # -> Segments, simplify(Vertices)
shift = ShiftList(List=explode.Vertices, Shift=1, Wrap=False)
short = ShortestList(ListA=explode.Vertices, ListB=shift, TrimMode=2)  # -> ListA, ListB
item = ListItem(List=short.ListA, Index=0, Wrap=True)  # -> Item, Item1
item_2 = ListItem(List=short.ListB, Index=0, Wrap=True)  # -> Item, Item1
vec2pt = Vector2Pt(PointA=item.Item, PointB=item_2.Item, Unitize=False)  # -> Vector, Length
vec2pt_2 = Vector2Pt(PointA=item.Item1, PointB=item_2.Item1, Unitize=False)  # -> Vector, Length
Z = UnitZ(Factor=1)
xprod = CrossProduct(VectorA=vec2pt.Vector, VectorB=vec2pt_2.Vector, Unitize=False)  # -> Vector, Length
cset = CreateSet(List=explode.Vertices)  # -> Set, Map
dprod = DotProduct(VectorA=xprod.Vector, VectorB=Z, Unitize=True)
larger = LargerThan(FirstNumber=dprod, SecondNumber=0)  # -> LargerThan, OrEqualTo
rev = ReverseList(List=cset.Set)
cull = CullPattern(List=rev, CullPattern=invert(larger.LargerThan))
cull_2 = CullPattern(List=cset.Set, CullPattern=larger.LargerThan)
merge = Merge(Data1=cull_2, Data2=cull)
pline = PolyLine(Vertices=merge, Closed=Toggle(True))
boundaries = Data(flatten(pline))
boundaries_2 = ClusterOutput(boundaries)

# ==== cluster Cluster_3
solarabsorptivity = ClusterInput()
solarabsorptivity_2 = Data(solarabsorptivity)
subtraction = Subtraction(A="1", B=solarabsorptivity_2)
reflectivity = Data(subtraction)
reflectivity_2 = ClusterOutput(reflectivity)

# ==== cluster Cluster_4
layername = ClusterInput()
toplayer = ClusterInput()
layername_2 = Data(layername)
toplayer_2 = Data(toplayer)
concat = Concatenate(FragmentA=toplayer_2, FragmentC="::", FragmentB=layername_2)
dpipeline = DynamicGeometryPipeline(
    LayerFilter=concat,
    TypeFilter="Brep",
    NameFilter="*",
    GroupByLayer=False,
    GroupByType=False,
    IncludeHidden=True,
    IncludeLocked=True,
    enableFullPath=True,
    listenToAttributes=True)  # -> simplify(flatten(GeometryOut))
lng = ListLength(List=dpipeline)
series = Series(Start=0, Step=1, Count=lng)
concat_2 = Concatenate(FragmentA=layername_2, FragmentB=series)
brepnames = Data(concat_2)
brep = Brep(dpipeline)
brepnames_2 = ClusterOutput(brepnames)
brep_2 = ClusterOutput(brep)
